# Grasshopper definition testSuite.gh (Grasshopper 1.0.7)
# plug-ins: Objectivism, Objectify

square_edge_length = Slider(2, range=0..10)
graft = GraftTree(Tree="Haskell", IncludeEmptyLists=True, IncludeNullItems=True)
squares_per_side = Slider(8, range=0..10)
graft_2 = GraftTree(Tree=graft, IncludeEmptyLists=True, IncludeNullItems=True)
# Trying to break it
panel = Panel("Kate Green")
# Objectivity Test Suite
panel_2 = Panel("John")
# Test with some lists of strings
panel_3 = Panel("5")
# Symmetry test
crv = Curve(<curve referenced from the Rhino model>)
crv_2 = Curve(<curve referenced from the Rhino model>)
crv_3 = Curve(<curve referenced from the Rhino model>)
# Chess board test
subd = SubD(<subd referenced from the Rhino model>)
pipeline = GeometryPipeline(
    GroupByLayer=False,
    GroupByType=False,
    IncludeHidden=True,
    IncludeLocked=True,
    LayerFilter="No Column Zones",
    NameFilter="*",
    SublayerFiltering=True,
    TypeFilter=4)
developer = CreateObject(FirstName="David", LastName="Rutten", FavouriteLanguage=graft_2)
pipeline_2 = GeometryPipeline(
    GroupByLayer=False,
    GroupByType=False,
    IncludeHidden=True,
    IncludeLocked=True,
    LayerFilter="X Gridline Points",
    NameFilter="*",
    SublayerFiltering=True,
    TypeFilter=1)
pipeline_3 = GeometryPipeline(
    GroupByLayer=False,
    GroupByType=False,
    IncludeHidden=True,
    IncludeLocked=True,
    LayerFilter="Y Gridline Points",
    NameFilter="*",
    SublayerFiltering=True,
    TypeFilter=1)
person = CreateObject(FirstName=panel_2, LastName="Deer", Age="36")
person_2 = CreateObject(FirstName="Jane", LastName="Doe", Age="36")
person_3 = CreateObject(FirstName="David", LastName="Rutten", Age=panel_3)
face = CreateObject(Eye=crv, Nose=crv_2, Mouth=crv_3)
person_4 = CreateObject(FirstName="John", LastName="Deer", Age="36")
person_5 = CreateObject(FirstName="Jane", LastName="Doe", Age="36")
object = CreateObject(Property1=subd)
team = CreateObject(
    TeamName="The Cabinet",
    Players=["Boris Johnson", "Rishi Sunak", "Dominic Raab", "Priti Patel", "Matt Hancock", "Gavin Williamson"])
team_2 = CreateObject(
    TeamName="The Shadow Cabinet",
    Players=["Sir Keir Starmer", "Anneliese Dodds", "Lisa Nandy", "Nick Thomas-Symonds", "Jonathan Ashworth", panel])
series = Series(Start=0, Step=1, Count=squares_per_side)
series_2 = Series(Start=1, Step=1, Count=squares_per_side)
rectangle = Rectangle(Plane=PlaneXY(0, 0, 0), XSize=square_edge_length, YSize=square_edge_length, Radius=0)  # -> Rectangle, Length
yz = YZPlane(Origin=Point(0, 0, 0))
xz = XZPlane(Origin=Point(0, 0, 0))
mirror = Mirror(Geometry=face, Plane=PlaneYZ(0, 0, 0))  # -> Geometry, Transform
move = Move(Geometry=object, Motion=Vector(0, 0, 10))  # -> Geometry, Transform
merge = Merge(Data1=person, Data2=person_2, Data3=person_3)
merge_2 = Merge(Data1=person_4, Data2=person_5, Data3=developer)
ghpython_script = GhPythonScript(N=series_2)  # -> L; inputs N: Int32
# ---------- ghpython_script: Python ----------
L = chr(ord('@')+N)
# ---------- end ghpython_script ----------
crv_4 = Curve(rectangle.Rectangle)
merge_3 = Merge(Data1=face, Data2=mirror.Geometry)
project = Project(Geometry=pipeline_2, Plane=yz)  # -> Geometry, Transform
multiplication = Multiplication(A=square_edge_length, B=series)
project_2 = Project(Geometry=pipeline_3, Plane=xz)  # -> Geometry, Transform
merge_4 = Merge(Data1=team, Data2=team_2)
multipletypes = GetObjectProperties(Object=merge_2, GraftItemsToggle=False)  # -> FirstName, LastName, Age, FavouriteLanguage
boundary = BoundarySurfaces(Edges=crv_4)
person_6 = GetObjectProperties(Object=merge, GraftItemsToggle=False)
face_2 = GetObjectProperties(Object=merge_3, GraftItemsToggle=False)  # -> Eye, Mouth
pdecon = Deconstruct(Point=project.Geometry)  # -> XComponent, YComponent, ZComponent
pdecon_2 = Deconstruct(Point=project_2.Geometry)  # -> XComponent, YComponent, ZComponent
vec = VectorXYZ(XComponent=multiplication, YComponent=graft(multiplication), ZComponent=0)  # -> simplify(graft(Vector)), Length
team_3 = GetObjectProperties(Object=merge_4, GraftItemsToggle=True)  # -> TeamName, Players
concat = Concatenate(FragmentA=ghpython_script, FragmentC=graft(series_2))  # -> simplify(graft(Result))
equals = Equality(FirstNumber=person_6, SecondNumber=36)  # -> Equality, Inequality
chesssquare = CreateObject(Square=boundary, Colour=ColourSwatch(SwatchColor=RGB(255, 255, 255)), PositionTag="A1")
object_2 = Objectify(MemberInput="SomeText")
sort = SortList(Keys=pdecon.YComponent, ValuesA=project.Geometry)  # -> Keys, ValuesA
sort_2 = SortList(Keys=pdecon_2.XComponent, ValuesA=project_2.Geometry)  # -> Keys, ValuesA
panel_4 = Panel(multipletypes.FavouriteLanguage)
cull = CullPattern(List=merge, CullPattern=equals.Equality)
xz_2 = XZPlane(Origin=sort.ValuesA)
data = Data(null)
yz_2 = YZPlane(Origin=sort_2.ValuesA)
data_2 = Data(null)
output = DataOutput(
    DataInput=cull,
    Destination="C:\Users\Dominic\source\repos\Objectivism\tests\TestExport1.ghdata",
    RelativePath="C:\Users\Dominic\source\repos\Objectivism\tests\TestExport1.ghdata|TestExport1.ghdata")
move_2 = Move(Geometry=chesssquare, Motion=vec.Vector)  # -> Geometry, Transform
lng = ListLength(List=yz_2)
lng_2 = ListLength(List=xz_2)
input = DataInput(
    Destination="C:\Users\Dominic\source\repos\Objectivism\tests\TestExport1.ghdata",
    RelativePath="C:\Users\Dominic\source\repos\Objectivism\tests\TestExport1.ghdata|TestExport1.ghdata",
    UpdateDelay=9223372036854775807)
tstat = TreeStatistics(Tree=move_2.Geometry)  # -> Paths, Length, Count
series_3 = Series(Start=1, Step=1, Count=lng)
series_4 = Series(Start=1, Step=1, Count=lng_2)
data_3 = Data(input)
person_7 = GetObjectProperties(Object=input, GraftItemsToggle=False)  # -> FirstName, LastName, Age
dpath = DeconstructPath(Branch=tstat.Paths)
txt = Text(series_4)
ghpython_script_2 = GhPythonScript(N=series_3)  # -> L; inputs N: Int32; same code as ghpython_script
iseven = GhPythonScript(I=dpath)  # -> R; inputs I: Int32
# ---------- iseven: Python ----------
R = I%2 == 0
# ---------- end iseven ----------
panel_5 = Panel(person_7.Age)
panel_6 = Panel(person_7.FirstName)
panel_7 = Panel(person_7.LastName)
gridline = CreateObject(Plane=xz_2, Name=txt)
gridline_2 = CreateObject(Plane=yz_2, Name=ghpython_script_2)
item = ListItem(List=iseven, Index=0, Wrap=True)  # -> Item, Item1
xor = GateXor(A=item.Item, B=item.Item1)
p_n_c = PickNChoose(Pattern=xor, Stream0=ColourSwatch(SwatchColor=RGB(212, 195, 159)), Stream1=ColourSwatch(SwatchColor=RGB(79, 59, 50)))
xy = XYPlane(Origin=Point(0, 0, 0))
add_change = AddOrChangeProperties(Object=move_2.Geometry, PropertyName=p_n_c, PropertyToChange=concat)

# ---- group: Build column base points at grid line intersections
cluster = Cluster(baseplane=xy, gl_y=gridline_2, gl_x=gridline)

# ----
tbox = TwistedBox(
    CornerA=<geometry referenced from the Rhino model>,
    CornerB=<geometry referenced from the Rhino model>,
    CornerC=<geometry referenced from the Rhino model>,
    CornerD=<geometry referenced from the Rhino model>,
    CornerE=<geometry referenced from the Rhino model>,
    CornerF=<geometry referenced from the Rhino model>,
    CornerG=<geometry referenced from the Rhino model>,
    CornerH=<geometry referenced from the Rhino model>)
output_2 = DataOutput(
    DataInput=add_change,
    Destination="C:\Users\Dominic\source\repos\Objectivism\tests\ChessboardTest.ghdata",
    RelativePath="C:\Users\Dominic\source\repos\Objectivism\tests\ChessboardTest.ghdata|ChessboardTest.ghdata")
input_2 = DataInput(
    Destination="C:\Users\Dominic\source\repos\Objectivism\tests\ChessboardTest.ghdata",
    RelativePath="C:\Users\Dominic\source\repos\Objectivism\tests\ChessboardTest.ghdata|ChessboardTest.ghdata",
    UpdateDelay=5000000)

# ---- group: ColumnBases outside of no column curves
cluster_2 = Cluster_2(columnbase=cluster, no_column_curves=pipeline)

# ----
bbox = BoundingBox(Content=flatten(input_2), Plane=PlaneXY(0, 0, 0), UnionBox=True)  # -> Box, Box_2
morph = BoxMorph(
    Geometry=input_2,
    Reference={Plane=PlaneXY(-0.6059629419, -1.01904337, 0), X=Domain(0, 17.81923451), Y=Domain(0, 18.51325993), Z=Domain(0, 5.907230943)},
    Target=tbox)
columnbase = Data(cluster_2)
chesssquare_2 = GetObjectProperties(Object=morph, GraftItemsToggle=True)  # -> Square, Colour, PositionTag
pt = Point(Point(0, 0, 0.3))
pt_2 = Point(Point(0, 0, 1))
area = Area(Geometry=chesssquare_2.Square)  # -> Area, Centroid
addition = Addition(A=area.Centroid, B=pt)
preview = CustomPreview(Geometry=chesssquare_2.Square, Material=chesssquare_2.Colour)
tag = TextTag3D(Location=addition, Text=chesssquare_2.PositionTag, Size=0.5, Justification=5)

# ==== cluster Cluster
baseplane = ClusterInput()
gl_x = ClusterInput()
gl_y = ClusterInput()
gridline = GetObjectProperties(Object=gl_y, GraftItemsToggle=False)  # -> Plane, Name
gridline_2 = GetObjectProperties(Object=gl_x, GraftItemsToggle=False)  # -> Plane, Name
_3px = PlanePlanePlane(PlaneA=baseplane, PlaneB=gridline.Plane, PlaneC=graft(gridline_2.Plane))  # -> Point, LineAB, LineAC, LineBC
concat = Concatenate(FragmentA=gridline.Name, FragmentB=graft(gridline_2.Name))
columnbase = CreateObject(Point=_3px.Point, CoordTag=concat)  # -> graft(Object)
columnbase_2 = Data(columnbase)
columnbase_3 = ClusterOutput(columnbase_2)

# ==== cluster Cluster_2
no_column_curves = ClusterInput()
columnbase = ClusterInput()
no_column_curves_2 = Curve(no_column_curves)
columnbase_2 = Data(columnbase)
columnbase_3 = GetObjectProperties(Object=columnbase_2, GraftItemsToggle=False)
incurves = PointInCurves(Point=columnbase_3, Curves=no_column_curves_2)  # -> Relationship, Index, Point
equals = Equality(FirstNumber=incurves.Relationship, SecondNumber=0)  # -> Equality, Inequality
cull = CullPattern(List=columnbase_2, CullPattern=equals.Equality)
columnbase_4 = Data(cull)
columnbase_5 = ClusterOutput(columnbase_4)
